# Dynamo graph 04-INPUT-02-BuildingNumber-210427.dyn "04-INPUT-02-BuildingNumber-210330" (Dynamo 2.3.0.5885)

categories = StringInput("""Structural Foundations
Structural Framing
Structural Columns
Walls
Floors
Stairs
Parts
Generic Models""")  # graph input
parameter_name = StringInput("COF_GEN__BuildingNumber")  # graph input
parameter_value = StringInput("DOF")  # graph input
python_script_get_elements_of = Python(IN[0]=categories, IN[1]=parameter_name, IN[2]=parameter_value)  # "Python Script-Get Elements Of Listed Categories & Set Parameter Value"
# ---------- python_script_get_elements_of.python (48 lines) ----------
# Load the Python Standard and DesignScript Libraries
import sys,os,json,tempfile,re
from shutil import copyfile
from json import *
import clr
clr.AddReference('ProtoGeometry')
from Autodesk.DesignScript.Geometry import *
clr.AddReference('RevitAPI')
from Autodesk.Revit.DB import *
clr.AddReference('RevitAPIUI')
from Autodesk.Revit.UI import TaskDialog
clr.AddReference("RevitNodes")
import Revit
clr.ImportExtensions(Revit.Elements)
clr.AddReference("RevitServices")
import RevitServices
from RevitServices.Persistence import DocumentManager
from RevitServices.Transactions import TransactionManager
from System.Collections.Generic import *
clr.ImportExtensions(Revit.GeometryConversion)
## add module director
dynPyDir = r"\\hcmcfcfs01\databim$\BimESC\00-BIM STANDARD\PYTHON\pythondynamo"
sys.path.append(dynPyDir)
import pyDyn
from pyDyn import *
##
doc = DocumentManager.Instance.CurrentDBDocument
uiapp = DocumentManager.Instance.CurrentUIApplication
app = uiapp.Application

opt = Options()
categories = doc.Settings.Categories

# The inputs to this node will be stored as a list in the IN variables.
dataEnteringNode = IN
cates = IN[0]
paramName = IN[1]
paramValue = IN[2]
# Place your code below this line

newcats = splitDynString(cates)

elements = getAllElementsOfCategories(newcats,doc)

res = setParameterValue(doc,elements,paramName,paramValue)

# Assign your output to the OUT variable.
OUT = res
# ----------------------------------------
