# Dynamo graph 09-Tranfer Value Param A to B-210508.dyn (Dynamo 2.1.0.7500)

boolean_to_string_true_string = BoolSelector(true)  # graph input
instance_or_type_true_type = BoolSelector(true)  # graph input
category = StringInput("""Structural Foundations
Structural Framing
Structural Columns
Walls
Floors""")  # graph input
param_a_type_or_instance = StringInput("""Cut Length
b
h""")  # graph input
instance_param_b_string_or = StringInput("""COF_GEN__Length
COF_GEN__Width
COF_GEN__Height""")  # "Instance Param B (String or Double)"; graph input
python_script = Python(IN[0]=boolean_to_string_true_string, IN[1]=instance_or_type_true_type, IN[2]=category, IN[3]=param_a_type_or_instance, IN[4]=instance_param_b_string_or)
# ---------- python_script.python (82 lines) ----------
# Load the Python Standard and DesignScript Libraries
import sys,os,json,tempfile
from shutil import copyfile
from json import *
import clr
clr.AddReference('ProtoGeometry')
from Autodesk.DesignScript.Geometry import *
clr.AddReference('RevitAPI')
from Autodesk.Revit.DB import *
clr.AddReference('RevitAPIUI')
from Autodesk.Revit.UI import TaskDialog
clr.AddReference("RevitNodes")
import Revit
clr.ImportExtensions(Revit.Elements)
clr.AddReference("RevitServices")
import RevitServices
from RevitServices.Persistence import DocumentManager
from RevitServices.Transactions import TransactionManager
from System.Collections.Generic import *
clr.ImportExtensions(Revit.GeometryConversion)

## add module director
dynPyDir = r"C:\Users\USER\Documents\GitHub\cofico\cofico\FROM BIM MASTER TEMP 210412\Python\pythonDynamo"#r"\\hcmcfcfs01\databim$\BimESC\00-BIM STANDARD\PYTHON\pythondynamo"#
sys.path.append(dynPyDir)
import pyDyn
from pyDyn import *
##
doc = DocumentManager.Instance.CurrentDBDocument
uiapp = DocumentManager.Instance.CurrentUIApplication
app = uiapp.Application

opt = Options()
categories = doc.Settings.Categories
# The inputs to this node will be stored as a list in the IN variables.
dataEnteringNode = IN

convertToString = IN[0]
isType = IN[1]
cateStrings = IN[2]
paramAA = IN[3]
paramBB = IN[4]

listParamA = splitDynString(paramAA)
listParamB = splitDynString(paramBB)

# Place your code below this line
cates = splitDynString2(cateStrings,doc)
allElements = getAllElementsOfCategories(cates,doc)
res = []
if convertToString:
	with Transaction(doc, "Transfer Data") as ttd:
		ttd.Start()
		for elem in allElements:
			try:
				if len(listParamA) ==len(listParamB):
					for ii in range(len(listParamA)):
						
						paramA = listParamA[ii]
						paramB = listParamB[ii]
						
						elemParamA = None
						if elem.LookupParameter(paramA):
							elemParamA = elem.LookupParameter(paramA)
						else:			
							elemParamA = doc.GetElement(elem.GetTypeId()).LookupParameter(paramA)				
						valueA = None
						if elemParamA.StorageType == StorageType.Double and not elemParamA.DisplayUnitType == DisplayUnitType.DUT_DECIMAL_DEGREES and not elemParamA.DisplayUnitType == DisplayUnitType.DUT_SLOPE_DEGREES:		valueA = elemParamA.AsDouble()				
						#validate
						elemParamB = elem.LookupParameter(paramB)
						if float(valueA) and elemParamB.StorageType == StorageType.Double: #neu là Double
							
							elemParamB.Set(valueA)
						if elemParamB.StorageType == StorageType.String:
							valueA = elemParamA.AsValueString()
							elemParamB.Set(valueA)						
						res.append(valueA)
			except:
				pass
		ttd.Commit()

# Assign your output to the OUT variable.
OUT = res
# ----------------------------------------
python_script_unit = Python()  # unwired: IN[0]
# ---------- python_script_unit.python (59 lines) ----------
# Load the Python Standard and DesignScript Libraries
import sys,os,json
import clr
clr.AddReference('ProtoGeometry')
from Autodesk.DesignScript.Geometry import *

clr.AddReference('RevitAPI')
from Autodesk.Revit.DB import *
clr.AddReference('RevitAPIUI')
from Autodesk.Revit.UI import TaskDialog
clr.AddReference("RevitNodes")
import Revit
clr.ImportExtensions(Revit.Elements)
clr.AddReference("RevitServices")
import RevitServices
from RevitServices.Persistence import DocumentManager
from RevitServices.Transactions import TransactionManager
from System.Collections.Generic import *
clr.ImportExtensions(Revit.GeometryConversion)

##
doc = DocumentManager.Instance.CurrentDBDocument
uiapp = DocumentManager.Instance.CurrentUIApplication
app = uiapp.Application

opt = Options()
categories = doc.Settings.Categories
# The inputs to this node will be stored as a list in the IN variables.
dataEnteringNode = IN

def setupUnit(doc):	
	try:
		#Area
		unit = Units(UnitSystem.Metric)		
		fmOp = FormatOptions(DisplayUnitType.DUT_SQUARE_METERS,UnitSymbolType.UST_NONE,0.001)
		
		unit.SetFormatOptions(UnitType.UT_Area,fmOp)
		
		doc.SetUnits(unit)
		#Volume
		unit1 = Units(UnitSystem.Metric)
	
		fmOp1 = FormatOptions(DisplayUnitType.DUT_CUBIC_METERS,UnitSymbolType.UST_NONE,0.001)
		
		unit.SetFormatOptions(UnitType.UT_Volume,fmOp1)
		
		doc.SetUnits(unit)
		#doc.GetUnits().SetFormatOptions(UnitType.UT_Area,fmOp)
	except Exception, e:
		pass

	
##############   EXECUTION    #######################
with Transaction(doc,"Units setup") as t:		
	t.Start()
	setupUnit(doc)
	t.Commit()
# Assign your output to the OUT variable.
OUT = "OK"
# ----------------------------------------
help = StringInput("""COF_GEN__Length
COF_GEN__Width
COF_GEN__Height
COF_GEN__Thickness
COF_GEN__Perimeter
COF_GEN__Area
COF_GEN__Volume
""")  # graph input
help_2 = StringInput("""Structural Foundations
Structural Framing
--> b,h,Cut Length
Structural Columns
-->b,h,Length
Walls
-->Width,Length,Unconnected Height
Floors
-->Default Thickness
Stairs
Parts
Generic Models
Curtain Panels
Roofs""")  # graph input
