# Dynamo graph 10-ON OFF ENABLE ANALYTICAL MODEL-210506.dyn (Dynamo 2.3.0.5885)

param_name = StringInput("Enable Analytical Model")
value = CodeBlock { 0; }
cates = StringInput("""Structural Foundations
Structural Framing
Structural Columns
Walls""")  # graph input
python_script = Python(IN[0]=cates)
# ---------- python_script.python (40 lines) ----------
# Load the Python Standard and DesignScript Libraries
import sys,os,json,tempfile
from shutil import copyfile
from json import *
import clr
clr.AddReference('ProtoGeometry')
from Autodesk.DesignScript.Geometry import *
clr.AddReference('RevitAPI')
from Autodesk.Revit.DB import *
clr.AddReference('RevitAPIUI')
from Autodesk.Revit.UI import TaskDialog
clr.AddReference("RevitNodes")
import Revit
clr.ImportExtensions(Revit.Elements)
clr.AddReference("RevitServices")
import RevitServices
from RevitServices.Persistence import DocumentManager
from RevitServices.Transactions import TransactionManager
from System.Collections.Generic import *
clr.ImportExtensions(Revit.GeometryConversion)

## add module director
dynPyDir = r"\\hcmcfcfs01\databim$\BimESC\00-BIM STANDARD\PYTHON\pythondynamo"#r"C:\Users\USER\Documents\GitHub\cofico\cofico\FROM BIM MASTER TEMP 210412\Python\pythonDynamo"#
sys.path.append(dynPyDir)
import pyDyn
from pyDyn import *
##
doc = DocumentManager.Instance.CurrentDBDocument
uiapp = DocumentManager.Instance.CurrentUIApplication
app = uiapp.Application

opt = Options()
categories = doc.Settings.Categories
# The inputs to this node will be stored as a list in the IN variables.
dataEnteringNode = IN
cates = IN[0]
# Place your code below this line

# Assign your output to the OUT variable.
OUT = [e for e in getAllElementsOfCategories(splitDynString(cates),doc)]
# ----------------------------------------
code_block = CodeBlock(param=param_name, value=value, elems=python_script) { param; value; elems; }
setParameterByName = Element.SetParameterByName(element=code_block.elems, parameterName=code_block.param, value=code_block.value)
