# Dynamo graph DYNAMO AUTOCAD DATA-210511.dyn (Dynamo 2.10.0.3455)

file_path = Filename("..\..\..\..\..\..\..\..\Downloads\CHG\02B-CL BM-01.json")
python_script = Python(IN[0]=file_path)  # IronPython2
# ---------- python_script.python (37 lines) ----------
# Load the Python Standard and DesignScript Libraries
import sys, json
import clr
clr.AddReference('ProtoGeometry')
from Autodesk.DesignScript.Geometry import *
####
def readJson(path):	
	res = []
	with open(path,"r") as f:
		for j in json.load(f):
			res.append(j)
	return res
# The inputs to this node will be stored as a list in the IN variables.
dataEnteringNode = IN
jsonPath = IN[0]
# Place your code below this line
data = readJson(jsonPath)

dataPoints = []
for dat in data:
	try:
		translate = dat.get("TranslateCoordinateSystem").split(" ")
		
		deltaX = float(translate[0])
		deltaY = float(translate[1])
		deltaZ = float(translate[2])
		rotation = float(translate[3])
		
		X = float(dat.get("Position X"))-deltaX
		Y = float(dat.get("Position Y"))-deltaY
		
		point = Point.ByCoordinates(X,Y,0)
		dataPoints.append(point)
	except:
		pass
# Assign your output to the OUT variable.
OUT = dataPoints
# ----------------------------------------
watch = Watch(python_script)
file_path_2 = Filename("..\..\..\..\..\..\..\..\Downloads\CHG\CHG-S-PD-B2 B1-210504.json")
python_script_2 = Python(IN[0]=file_path_2)  # IronPython2
# ---------- python_script_2.python (42 lines) ----------
# Load the Python Standard and DesignScript Libraries
import sys, json
import clr
clr.AddReference('ProtoGeometry')
from Autodesk.DesignScript.Geometry import *
####
def readJson(path):	
	res = []
	with open(path,"r") as f:
		for j in json.load(f):
			res.append(j)
	return res
# The inputs to this node will be stored as a list in the IN variables.
dataEnteringNode = IN
jsonPath = IN[0]
# Place your code below this line
data = readJson(jsonPath)

dataPoints = []
for dat in data:
	try:
		XYZs = str(dat.get("LocationPoint")).split(" ")
		if len(XYZs) == 3:
			X = float(XYZs[0])
			Y = float(XYZs[1])
			point = Point.ByCoordinates(X,Y,0)
			dataPoints.append(point)
		if len(XYZs) == 6:
			X1 = float(XYZs[0])
			Y1 = float(XYZs[1])
			point1 = Point.ByCoordinates(X1,Y1,0)
			dataPoints.append(point1)
			
			X2 = float(XYZs[3])
			Y2 = float(XYZs[4])
			point2 = Point.ByCoordinates(X2,Y2,0)
			dataPoints.append(point2)		
	except Except, ex:
		dataPoints.append(ex)
		pass
# Assign your output to the OUT variable.
OUT = dataPoints
# ----------------------------------------
watch_2 = Watch(python_script_2)
