# Dynamo graph DYNAMO AUTOCAD DATA-210518.dyn (Dynamo 2.10.0.3455)

file_path_autocad_location_data = Filename("..\..\..\..\..\..\..\..\Downloads\CHG\Acad (1)\Combine.json")  # graph input
file_path_level_data = Filename("..\..\..\..\..\..\..\..\Downloads\CHG\Datum data\Combine.json")  # graph input
python_script = Python(IN[0]=file_path_autocad_location_data, IN[1]=file_path_level_data)  # IronPython2
# ---------- python_script.python (40 lines) ----------
# Load the Python Standard and DesignScript Libraries
import sys, json
import clr
clr.AddReference('ProtoGeometry')
from Autodesk.DesignScript.Geometry import *
####
def readJson(path):	
	res = []
	with open(path,"r") as f:
		for j in json.load(f):
			res.append(j)
	return res
# The inputs to this node will be stored as a list in the IN variables.
dataEnteringNode = IN
CadLocationDataPath = IN[0] # must be Json format
levelDataPath = IN[1] # must be Json format
# Place your code below this line
cadLocationData = readJson(CadLocationDataPath)

levelData = readJson(levelDataPath)

dataPoints = []
for dat in cadLocationData:
	try:
		translate = dat.get("TranslateCoordinateSystem")[1:-1].split(" ")
		
		deltaX = float(translate[0])
		deltaY = float(translate[1])
		#deltaZ = float(translate[2])
		#rotation = float(translate[3])
		
		X = float(dat.get("Position X"))-deltaX
		Y = float(dat.get("Position Y"))-deltaY
		
		point = Point.ByCoordinates(X,Y,0)
		dataPoints.append(point)
	except:
		pass
# Assign your output to the OUT variable.
OUT = levelData,cadLocationData,dataPoints
# ----------------------------------------
code_block = CodeBlock(res=python_script) { res[0]; res[1]; res[2]; }
watch = Watch(code_block.out0)
file_path = Filename("..\..\..\..\..\..\..\..\Downloads\CHG\CHG-S-PD-B2-210504.json")
python_script_2 = Python(IN[0]=file_path)  # IronPython2; frozen
# ---------- python_script_2.python (42 lines) ----------
# Load the Python Standard and DesignScript Libraries
import sys, json
import clr
clr.AddReference('ProtoGeometry')
from Autodesk.DesignScript.Geometry import *
####
def readJson(path):	
	res = []
	with open(path,"r") as f:
		for j in json.load(f):
			res.append(j)
	return res
# The inputs to this node will be stored as a list in the IN variables.
dataEnteringNode = IN
jsonPath = IN[0]
# Place your code below this line
data = readJson(jsonPath)

dataPoints = []
for dat in data:
	try:
		XYZs = str(dat.get("LocationPoint")).split(" ")
		if len(XYZs) == 3:
			X = float(XYZs[0])
			Y = float(XYZs[1])
			point = Point.ByCoordinates(X,Y,0)
			dataPoints.append(point)
		if len(XYZs) == 6:
			X1 = float(XYZs[0])
			Y1 = float(XYZs[1])
			point1 = Point.ByCoordinates(X1,Y1,0)
			dataPoints.append(point1)
			
			X2 = float(XYZs[3])
			Y2 = float(XYZs[4])
			point2 = Point.ByCoordinates(X2,Y2,0)
			dataPoints.append(point2)		
	except Except, ex:
		dataPoints.append(ex)
		pass
# Assign your output to the OUT variable.
OUT = dataPoints
# ----------------------------------------
watch_2 = Watch(python_script_2)
watch_3 = Watch(code_block.out1)
