# Dynamo graph readExcel_OpenPyXl.dyn (Dynamo 2.10.0.3455)

python_script = Python()  # IronPython2; unwired: IN[0]
# ---------- python_script.python (20 lines) ----------
# Load the Python Standard and DesignScript Libraries
import clr
clr.AddReference('ProtoGeometry')
from Autodesk.DesignScript.Geometry import *
import sys
#sys.path.append(r'C:\Users\USER\AppData\Local\Programs\Python\Python39\Lib\site-packages')
#import openpyxl

clr.AddReference("Microsoft.Office.Interop.Excel")
from Microsoft.Office.Interop.Excel import ApplicationClass
excel = ApplicationClass()
wb = excel.Workbooks.Add()
excel.Quit()
# The inputs to this node will be stored as a list in the IN variables.
dataEnteringNode = IN

# Place your code below this line

# Assign your output to the OUT variable.
OUT = 0
# ----------------------------------------
