# Dynamo graph 10-EXTRACT-REVIT ELEMENT INFO TO JSON-210502.dyn "08-EXTRACT-REVIT ELEMENT INFO TO JSON-210502" (Dynamo 2.1.0.7500)

list_category = StringInput("""Structural Foundations
Structural Framing
Structural Columns
Walls
Floors
Stairs
Parts
Generic Models
Curtain Panels
Roofs""")  # graph input
select_model_element = DSModelElementSelection()  # 1 picked in the model

# group: Write Element Properties (Instance and Type) to Json file
python_script_write_element = Python(IN[0]=list_category, IN[1]=select_model_element)  # "Python Script- Write Element Properties"
# ---------- python_script_write_element.python (54 lines) ----------
# Load the Python Standard and DesignScript Libraries
import sys,os,json,tempfile
from shutil import copyfile
from json import *
import clr
clr.AddReference('ProtoGeometry')
from Autodesk.DesignScript.Geometry import *
clr.AddReference('RevitAPI')
from Autodesk.Revit.DB import *
clr.AddReference('RevitAPIUI')
from Autodesk.Revit.UI import TaskDialog
clr.AddReference("RevitNodes")
import Revit
clr.ImportExtensions(Revit.Elements)
clr.AddReference("RevitServices")
import RevitServices
from RevitServices.Persistence import DocumentManager
from RevitServices.Transactions import TransactionManager
from System.Collections.Generic import *
clr.ImportExtensions(Revit.GeometryConversion)

## add module director
dynPyDir = r"C:\Users\USER\Documents\GitHub\cofico\cofico\FROM BIM MASTER TEMP 210412\Python\pythonDynamo"#r"\\hcmcfcfs01\databim$\BimESC\00-BIM STANDARD\PYTHON\pythondynamo"#
sys.path.append(dynPyDir)
import pyDyn
from pyDyn import *
##
doc = DocumentManager.Instance.CurrentDBDocument
uiapp = DocumentManager.Instance.CurrentUIApplication
app = uiapp.Application

opt = Options()
categories = doc.Settings.Categories
# The inputs to this node will be stored as a list in the IN variables.
dataEnteringNode = IN
e = UnwrapElement(IN[1]) # for TEST code
cates = IN[0]

path = revitDir(doc)[0]+revitDir(doc)[1]+'.json'

data = getAllCategoryElementsInfoDictionary(doc,cates)
dataStr = jsonString(data)

fileName = revitDir(doc)[1]+'.json'

tempfilepath = getTempFilePath(fileName)

filepath = revitDir(doc)[0]+revitDir(doc)[1]+'.json'

OUT = writeTxtStringToFile(tempfilepath,filepath,dataStr)

"""
data = getPropertiesDic(e,doc)
OUT = "Area" in data,data"""
# ----------------------------------------

watch = Watch(python_script_write_element)
python_script_setup_unit = Python()  # unwired: IN[0]
# ---------- python_script_setup_unit.python (59 lines) ----------
# Load the Python Standard and DesignScript Libraries
import sys,os,json
import clr
clr.AddReference('ProtoGeometry')
from Autodesk.DesignScript.Geometry import *

clr.AddReference('RevitAPI')
from Autodesk.Revit.DB import *
clr.AddReference('RevitAPIUI')
from Autodesk.Revit.UI import TaskDialog
clr.AddReference("RevitNodes")
import Revit
clr.ImportExtensions(Revit.Elements)
clr.AddReference("RevitServices")
import RevitServices
from RevitServices.Persistence import DocumentManager
from RevitServices.Transactions import TransactionManager
from System.Collections.Generic import *
clr.ImportExtensions(Revit.GeometryConversion)

##
doc = DocumentManager.Instance.CurrentDBDocument
uiapp = DocumentManager.Instance.CurrentUIApplication
app = uiapp.Application

opt = Options()
categories = doc.Settings.Categories
# The inputs to this node will be stored as a list in the IN variables.
dataEnteringNode = IN

def setupUnit(doc):	
	try:
		#Area
		unit = Units(UnitSystem.Metric)		
		fmOp = FormatOptions(DisplayUnitType.DUT_SQUARE_METERS,UnitSymbolType.UST_NONE,0.001)
		
		unit.SetFormatOptions(UnitType.UT_Area,fmOp)
		
		doc.SetUnits(unit)
		#Volume
		unit1 = Units(UnitSystem.Metric)
	
		fmOp1 = FormatOptions(DisplayUnitType.DUT_CUBIC_METERS,UnitSymbolType.UST_NONE,0.001)
		
		unit.SetFormatOptions(UnitType.UT_Volume,fmOp1)
		
		doc.SetUnits(unit)
		#doc.GetUnits().SetFormatOptions(UnitType.UT_Area,fmOp)
	except Exception, e:
		pass

	
##############   EXECUTION    #######################
with Transaction(doc,"Units setup") as t:		
	t.Start()
	setupUnit(doc)
	t.Commit()
# Assign your output to the OUT variable.
OUT = 0
# ----------------------------------------
select_model_elements = DSModelElementsSelection()  # nothing selected
