# Dynamo graph 10-EXTRACT-REVIT ELEMENT INFO TO JSON-210517.dyn (Dynamo 2.1.0.7500)

list_category = StringInput("""Structural Foundations
Structural Framing
Structural Columns
Walls
Floors
Stairs
Parts
Generic Models
Curtain Panels
Roofs""")  # graph input
combine_true_yes = BoolSelector(false)  # graph input

# group: Write Element Properties (Instance and Type) to Json file
python_script_write_element = Python(IN[0]=list_category, IN[1]=combine_true_yes)  # "Python Script- Write Element Properties"; frozen
# ---------- python_script_write_element.python (58 lines) ----------
# Load the Python Standard and DesignScript Libraries
import sys,os,json,tempfile
from shutil import copyfile
from json import *
import clr
clr.AddReference('ProtoGeometry')
from Autodesk.DesignScript.Geometry import *
clr.AddReference('RevitAPI')
from Autodesk.Revit.DB import *
clr.AddReference('RevitAPIUI')
from Autodesk.Revit.UI import TaskDialog
clr.AddReference("RevitNodes")
import Revit
clr.ImportExtensions(Revit.Elements)
clr.AddReference("RevitServices")
import RevitServices
from RevitServices.Persistence import DocumentManager
from RevitServices.Transactions import TransactionManager
from System.Collections.Generic import *
clr.ImportExtensions(Revit.GeometryConversion)

## add module director
dynPyDir = r"C:\Users\USER\Documents\GitHub\cofico\cofico\FROM BIM MASTER TEMP 210412\Python\pythonDynamo"#r"\\hcmcfcfs01\databim$\BimESC\00-BIM STANDARD\PYTHON\pythondynamo"#
sys.path.append(dynPyDir)
import pyDyn
from pyDyn import *
##
doc = DocumentManager.Instance.CurrentDBDocument
uiapp = DocumentManager.Instance.CurrentUIApplication
app = uiapp.Application

opt = Options()
categories = doc.Settings.Categories
# The inputs to this node will be stored as a list in the IN variables.
dataEnteringNode = IN
#e = UnwrapElement(IN[1]) # for TEST code
cates = IN[0]
combineFlag = IN[1]

path = revitDir(doc)[0]+revitDir(doc)[1]+'.json'

data = getAllCategoryElementsInfoDictionary(doc,cates)
dataStr = jsonString(data)

fileName = revitDir(doc)[1]+'.json'

tempfilepath = getTempFilePath(fileName)

filepath = revitDir(doc)[0]+revitDir(doc)[1]+'.json'

OUT = writeTxtStringToFile(tempfilepath,filepath,dataStr)

if combineFlag:
	pass

"""
data = getPropertiesDic(e,doc)
OUT = "Area" in data,data"""
# ----------------------------------------

watch = Watch(python_script_write_element)
python_script_setup_unit = Python()  # unwired: IN[0]
# ---------- python_script_setup_unit.python (59 lines) ----------
# Load the Python Standard and DesignScript Libraries
import sys,os,json
import clr
clr.AddReference('ProtoGeometry')
from Autodesk.DesignScript.Geometry import *

clr.AddReference('RevitAPI')
from Autodesk.Revit.DB import *
clr.AddReference('RevitAPIUI')
from Autodesk.Revit.UI import TaskDialog
clr.AddReference("RevitNodes")
import Revit
clr.ImportExtensions(Revit.Elements)
clr.AddReference("RevitServices")
import RevitServices
from RevitServices.Persistence import DocumentManager
from RevitServices.Transactions import TransactionManager
from System.Collections.Generic import *
clr.ImportExtensions(Revit.GeometryConversion)

##
doc = DocumentManager.Instance.CurrentDBDocument
uiapp = DocumentManager.Instance.CurrentUIApplication
app = uiapp.Application

opt = Options()
categories = doc.Settings.Categories
# The inputs to this node will be stored as a list in the IN variables.
dataEnteringNode = IN

def setupUnit(doc):	
	try:
		#Area
		unit = Units(UnitSystem.Metric)		
		fmOp = FormatOptions(DisplayUnitType.DUT_SQUARE_METERS,UnitSymbolType.UST_NONE,0.001)
		
		unit.SetFormatOptions(UnitType.UT_Area,fmOp)
		
		doc.SetUnits(unit)
		#Volume
		unit1 = Units(UnitSystem.Metric)
	
		fmOp1 = FormatOptions(DisplayUnitType.DUT_CUBIC_METERS,UnitSymbolType.UST_NONE,0.001)
		
		unit.SetFormatOptions(UnitType.UT_Volume,fmOp1)
		
		doc.SetUnits(unit)
		#doc.GetUnits().SetFormatOptions(UnitType.UT_Area,fmOp)
	except Exception, e:
		pass

	
##############   EXECUTION    #######################
with Transaction(doc,"Units setup") as t:		
	t.Start()
	setupUnit(doc)
	t.Commit()
# Assign your output to the OUT variable.
OUT = 0
# ----------------------------------------
file_path = Filename("..\combine.json")  # graph input
python_script_write_element_2 = Python(IN[0]=list_category, IN[1]=combine_true_yes, IN[2]=file_path)  # "Python Script- Write Element Properties"
# ---------- python_script_write_element_2.python (57 lines) ----------
# Load the Python Standard and DesignScript Libraries
import sys,os,json,tempfile
from shutil import copyfile
from json import *
import clr
clr.AddReference('ProtoGeometry')
from Autodesk.DesignScript.Geometry import *
clr.AddReference('RevitAPI')
from Autodesk.Revit.DB import *
clr.AddReference('RevitAPIUI')
from Autodesk.Revit.UI import TaskDialog
clr.AddReference("RevitNodes")
import Revit
clr.ImportExtensions(Revit.Elements)
clr.AddReference("RevitServices")
import RevitServices
from RevitServices.Persistence import DocumentManager
from RevitServices.Transactions import TransactionManager
from System.Collections.Generic import *
clr.ImportExtensions(Revit.GeometryConversion)

## add module director
dynPyDir = r"C:\Users\USER\Documents\GitHub\cofico\cofico\FROM BIM MASTER TEMP 210412\Python\pythonDynamo"#r"\\hcmcfcfs01\databim$\BimESC\00-BIM STANDARD\PYTHON\pythondynamo"#
sys.path.append(dynPyDir)
import pyDyn
from pyDyn import *
##
doc = DocumentManager.Instance.CurrentDBDocument
uiapp = DocumentManager.Instance.CurrentUIApplication
app = uiapp.Application

opt = Options()
categories = doc.Settings.Categories
# The inputs to this node will be stored as a list in the IN variables.
dataEnteringNode = IN
#e = UnwrapElement(IN[1]) # for TEST code
cates = IN[0]
combineFlag = IN[1]
filePathComb  = IN[2]

data = getAllCategoryElementsInfoDictionary2(doc,cates)


if combineFlag:
	combDat = readJson(filePathComb)
	union = combDat + data
	combDataStr = jsonString(union)
	#tempfilepathComb = getTempFilePath(filePathComb)
	OUT = writeTxtStringToFile2(filePathComb,combDataStr)
else:
	path = revitDir(doc)[0]+revitDir(doc)[1]+'.json'
	dataStr = jsonString(data)
	fileName = revitDir(doc)[1]+'.json'
	tempfilepath = getTempFilePath(fileName)
	filepath = revitDir(doc)[0]+revitDir(doc)[1]+'.json'
	OUT = writeTxtStringToFile(tempfilepath,filepath,dataStr)
	
# ----------------------------------------
