# Dynamo graph 11-COMBINE JSON-210512.dyn (Dynamo 2.10.0.3455)

file_path_a = Filename("..\combine.json")  # graph input
file_path_b = Filename("..\combine.json")  # graph input
python_script_write_element = Python(IN[0]=file_path_a, IN[1]=file_path_b)  # "Python Script- Write Element Properties"; IronPython2
# ---------- python_script_write_element.python (46 lines) ----------
# Load the Python Standard and DesignScript Libraries
import sys,os,json,tempfile
from shutil import copyfile
from json import *
import clr
clr.AddReference('ProtoGeometry')
from Autodesk.DesignScript.Geometry import *
clr.AddReference('RevitAPI')
from Autodesk.Revit.DB import *
clr.AddReference('RevitAPIUI')
from Autodesk.Revit.UI import TaskDialog
clr.AddReference("RevitNodes")
import Revit
clr.ImportExtensions(Revit.Elements)
clr.AddReference("RevitServices")
import RevitServices
from RevitServices.Persistence import DocumentManager
from RevitServices.Transactions import TransactionManager
from System.Collections.Generic import *
clr.ImportExtensions(Revit.GeometryConversion)

## add module director
dynPyDir = r"C:\Users\USER\Documents\GitHub\cofico\cofico\FROM BIM MASTER TEMP 210412\Python\pythonDynamo"#r"\\hcmcfcfs01\databim$\BimESC\00-BIM STANDARD\PYTHON\pythondynamo"#
sys.path.append(dynPyDir)
import pyDyn
from pyDyn import *
##
doc = DocumentManager.Instance.CurrentDBDocument
uiapp = DocumentManager.Instance.CurrentUIApplication
app = uiapp.Application

opt = Options()
categories = doc.Settings.Categories
# The inputs to this node will be stored as a list in the IN variables.
dataEnteringNode = IN
#e = UnwrapElement(IN[1]) # for TEST code
filePathComb  = IN[0]
filePath  = IN[1]


combDat = readJson(filePathComb)
data = readJson(filePath)
union = combDat + data
combDataStr = jsonString(union)
#tempfilepathComb = getTempFilePath(filePathComb)
OUT = writeTxtStringToFile2(filePathComb,combDataStr)
# ----------------------------------------
