# Dynamo graph 05-QTO 3D-(1B)-WRITE PARAM-GRID LOCATION DATA-run on REVIT-210122.dyn (Dynamo 2.3.0.5885)

# note: TIM VI TRI CUA DOI TUONG REVIT THEO DU LIEU HE LUOI TRUC
code_block = CodeBlock { "OST_StructuralFoundation"; "OST_StructuralColumns"; "OST_StructuralFraming"; "OST_Floors"; "OST_Walls"; "OST_Stairs"; }
byName = Category.ByName(name=code_block.out0)
all_elements_of_category = ElementsOfCategory(Category=byName)
location_from_origin = BoolSelector(false)  # graph input
code_block_2 = CodeBlock { origin = "0 0 0 0"; }
browse_manually = BoolSelector(true)  # graph input
file_path = Filename("..\..\..\01_PROJECTS\Z2\02-WIP\04_BIM_COORDINATED_MODEL\06 ONE PLACE\BIMData.xlsx")  # graph input
code_block_3 = CodeBlock { "Project Information"; "_DataSheet_Path"; defaultDataSheetName = "BIMData.xlsx"; }
byName_2 = Category.ByName(name=code_block_3.out0)
all_elements_of_category_2 = ElementsOfCategory(Category=byName_2)
getParameterValueByName = Element.GetParameterValueByName(element=all_elements_of_category_2, parameterName=code_block_3.out1)
python_script = Python(IN[0]=getParameterValueByName, IN[1]=code_block_3.defaultDataSheetName)
# ---------- python_script.python (67 lines) ----------
# Load the Python Standard and DesignScript Libraries
import sys
import clr
clr.AddReference('ProtoGeometry')
from Autodesk.DesignScript.Geometry import *

clr.AddReference('RevitAPI')
from Autodesk.Revit.DB import *
clr.AddReference('RevitAPIUI')
from Autodesk.Revit.UI import TaskDialog
clr.AddReference("RevitNodes")
import Revit
clr.ImportExtensions(Revit.Elements)
clr.AddReference("RevitServices")
import RevitServices
from RevitServices.Persistence import DocumentManager
from RevitServices.Transactions import TransactionManager
from System.Collections.Generic import *
clr.ImportExtensions(Revit.GeometryConversion)

##
doc = DocumentManager.Instance.CurrentDBDocument
uiapp = DocumentManager.Instance.CurrentUIApplication
app = uiapp.Application

opt = Options()
# The inputs to this node will be stored as a list in the IN variables.
dataEnteringNode = IN
datapath = IN[0]
dfDataSheetName = IN[1]


##

res = []

#res.append(app.VersionName)
#res.append(app.SharedParametersFilename)
#res.append(app.Username)
#res.append(doc.PathName)
#res.append(list(enumerate(doc.ProjectLocations)))
#res.append(doc.SiteLocation)
# Place your code below this line
dir = ""
dataFullPath =""

#
try:
	p = doc.PathName.split("\\")
	pp = p[0:len(p)-1]

	for s in pp:
		dir += s + "\\"
except:
	pass
#
dp = datapath[0]
if dp == "":
	dp = "./"+dfDataSheetName

try:
	dataFullPath = dir + dp[2:]
except:
	pass

# Assign your output to the OUT variable.
OUT = dataFullPath
# ----------------------------------------
if_ = If(test=browse_manually, true=file_path, false=python_script)
code_block_4 = CodeBlock(path=if_) { path; }
fromPath = FileObject(path=code_block_4)  # "File.FromPath"
code_block_5 = CodeBlock()
# ---------- code_block_5.designscript (4 lines) ----------
"GRID.INTERSECT.DAT";
//Sheet Name;
false;
//Read as string;
# ----------------------------------------
importExcel = Data.ImportExcel(file=fromPath, sheetName=code_block_5.out0, readAsStrings=code_block_5.out1)
deconstruct = List.Deconstruct(list=importExcel)
flatten = List.Flatten(list=deconstruct.rest)
python_script_2 = Python(IN[0]=flatten)
# ---------- python_script_2.python (20 lines) ----------
# Load the Python Standard and DesignScript Libraries
import sys
import clr
clr.AddReference('ProtoGeometry')
from Autodesk.DesignScript.Geometry import *

# The inputs to this node will be stored as a list in the IN variables.
dataEnteringNode = IN

data = IN[0]
res=[]
try:
	for d in data:	
		res.append(d.split("-")[1])
except Exception, e:
	OUT = e
# Place your code below this line

# Assign your output to the OUT variable.
OUT = res
# ----------------------------------------
if_2 = If(test=location_from_origin, true=code_block_2, false=python_script_2)
flatten_2 = List.Flatten(list=if_2)
parameter_name = StringInput("COF_GEN__LocationPoint")  # graph input
code_block_6 = CodeBlock(paramName=parameter_name) { paramName; }
code_block_7 = CodeBlock(elems=all_elements_of_category, dat=flatten_2, param=code_block_6) { elems; dat; param; }
location = FamilyInstance.Location(familyInstance=code_block_7.elems)
isNull = Object.IsNull(obj=location)
filterByBoolMask = List.FilterByBoolMask(list=code_block_7.elems, mask=isNull)
location_2 = FamilyInstance.Location(familyInstance=filterByBoolMask.out)
X = Point.X(point=location_2)
code_block_8 = CodeBlock { 1000; 1; }
div = X / code_block_8.out0
round = Math.Round(number=div, digits=code_block_8.out1)
Y = Point.Y(point=location_2)
div_2 = Y / code_block_8.out0
round_2 = Math.Round(number=div_2, digits=code_block_8.out1)
python_script_3 = Python(IN[0]=round, IN[1]=round_2)
# ---------- python_script_3.python (20 lines) ----------
import clr
clr.AddReference('ProtoGeometry')
from Autodesk.DesignScript.Geometry import *
#The inputs to this node will be stored as a list in the IN variables.
dataEnteringNode = IN

xx = IN[0]
yy = IN[1]

res = []

for i in range(len(xx)):
	try:
		res.append(xx[i].ToString()+" "+yy[i].ToString())
	except:
		res.append("null")
		pass

#Assign your output to the OUT variable.
OUT = res
# ----------------------------------------
python_script_nearest_intersect = Python(IN[0]=code_block_7.dat, IN[1]=python_script_3)  # "Python Script-Nearest Intersect Grid Point"
# ---------- python_script_nearest_intersect.python (45 lines) ----------
import clr
clr.AddReference('ProtoGeometry')
from Autodesk.DesignScript.Geometry import *
#The inputs to this node will be stored as a list in the IN variables.
dataEnteringNode = IN

intersectGridPoints = IN[0]
elemPoints = IN[1]

res = []

for p in elemPoints:
	try:
		gridA = ""
		gridB = ""
		dx = 0
		dy = 0
		
		x = float(p.split(" ")[0])
		y = float(p.split(" ")[1])
		r = []
		for a in intersectGridPoints:
			x1 = float(a.split(" ")[2])
			y1 = float(a.split(" ")[3])
			
			d = ((x1-x)**2+(y1-y)**2)**0.5
			r.append(d)
		
		idx = [i for i, zz in enumerate(r) if zz == min(r)]
		
		aaa= intersectGridPoints[idx[0]]
		
		gridA = aaa.split(" ")[0]
		gridB = aaa.split(" ")[1]
		dx = round(x-float(aaa.split(" ")[2]),3).ToString()
		dy = round(y-float(aaa.split(" ")[3]),3).ToString()
		str = gridA + " " + gridB + " " + dx + " " + dy
		
		res.append(str)
		
	except Exception, e:
		res.append(e)
		pass
#Assign your output to the OUT variable.
OUT = res
# ----------------------------------------
setParameterByName = Element.SetParameterByName(element=filterByBoolMask.out, parameterName=code_block_7.param, value=python_script_nearest_intersect)
byName_3 = Category.ByName(name=code_block.out1)
all_elements_of_category_3 = ElementsOfCategory(Category=byName_3)
code_block_9 = CodeBlock(elems=all_elements_of_category_3, dat=flatten_2, param=code_block_6) { elems; dat; param; }
# note: False = by BoundingBox Location
boolean_column_location = BoolSelector(false)  # graph input
code_block_10 = CodeBlock { "Column Location Mark"; }
getParameterValueByName_2 = Element.GetParameterValueByName(element=code_block_9.elems, parameterName=code_block_10)
python_script_4 = Python(IN[0]=getParameterValueByName_2)
# ---------- python_script_4.python (55 lines) ----------
import clr
clr.AddReference('ProtoGeometry')
from Autodesk.DesignScript.Geometry import *
#The inputs to this node will be stored as a list in the IN variables.
dataEnteringNode = IN

data = IN[0]
res = []
res1 = []

try:
	for d in data:
		res.append(d.replace("(-"," __").replace(")","").replace("("," "))
except:
	pass
	
try:
	for r in res:	
		#res1.append(r.split("-"))
		
		r0 = r.split("-")[0]
		r1 = r.split("-")[1]
		
		
		str = ""
		str1 = ""
		str2 = ""
		str3 = ""
		str4 = ""
		
		if " __" in r0:
			str1= r0.split(" __")[0]
			str3= "-"+round(float(r0.split(" __")[1])/1000,3).ToString()
		elif " " in r0:
			str1 = r0.split(" ")[0]
			str3 = round(float(r0.split(" ")[1])/1000,3).ToString()
		else:
			str1= r0
			
		if " __" in r1:
			str2= r1.split(" __")[0]
			str4= "-"+round(float(r1.split(" __")[1])/1000,3).ToString()
		elif " " in r1:
			str2 = r1.split(" ")[0]
			str4 = round(float(r1.split(" ")[1])/1000,3).ToString()
		else:
			str2= r1
		
		str = str1+" "+str2+" "+str3+" "+str4
		
		res1.append(str)
except:
	pass
#Assign your output to the OUT variable.
OUT = res1
# ----------------------------------------
boundingBox = Element.BoundingBox(element=code_block_9.elems)
flatten_3 = List.Flatten(list=boundingBox)
isNull_2 = Object.IsNull(obj=flatten_3)
filterByBoolMask_2 = List.FilterByBoolMask(list=boundingBox, mask=isNull_2)
maxPoint = BoundingBox.MaxPoint(boundingBox=filterByBoolMask_2.out)
minPoint = BoundingBox.MinPoint(boundingBox=filterByBoolMask_2.out)
byStartPointEndPoint = Line.ByStartPointEndPoint(startPoint=maxPoint, endPoint=minPoint)
code_block_11 = CodeBlock { 0.5; }
pointAtParameter = Curve.PointAtParameter(curve=byStartPointEndPoint, param=code_block_11)
X_2 = Point.X(point=pointAtParameter)
code_block_12 = CodeBlock { 1000; 1; }
div_3 = X_2 / code_block_12.out0
round_3 = Math.Round(number=div_3, digits=code_block_12.out1)
Y_2 = Point.Y(point=pointAtParameter)
div_4 = Y_2 / code_block_12.out0
round_4 = Math.Round(number=div_4, digits=code_block_12.out1)
python_script_5 = Python(IN[0]=round_3, IN[1]=round_4)  # same code as python_script_3
python_script_nearest_intersect_2 = Python(IN[0]=code_block_9.dat, IN[1]=python_script_5)  # "Python Script-Nearest Intersect Grid Point"; same code as python_script_nearest_intersect
if_3 = If(test=boolean_column_location, true=python_script_4, false=python_script_nearest_intersect_2)
setParameterByName_2 = Element.SetParameterByName(element=code_block_9.elems, parameterName=code_block_9.param, value=if_3)
byName_4 = Category.ByName(name=code_block.out2)
all_elements_of_category_4 = ElementsOfCategory(Category=byName_4)
code_block_13 = CodeBlock(elems=all_elements_of_category_4, dat=flatten_2, param=code_block_6) { elems; dat; param; }
location_3 = StructuralFraming.Location(structuralFraming=code_block_13.elems)
isNull_3 = Object.IsNull(obj=location_3)
filterByBoolMask_3 = List.FilterByBoolMask(list=code_block_13.elems, mask=isNull_3)
location_4 = StructuralFraming.Location(structuralFraming=filterByBoolMask_3.out)
startPoint = Curve.StartPoint(curve=location_4)
X_3 = Point.X(point=startPoint)
code_block_14 = CodeBlock { 1000; 1; }
div_5 = X_3 / code_block_14.out0
round_5 = Math.Round(number=div_5, digits=code_block_14.out1)
Y_3 = Point.Y(point=startPoint)
div_6 = Y_3 / code_block_14.out0
round_6 = Math.Round(number=div_6, digits=code_block_14.out1)
python_script_6 = Python(IN[0]=round_5, IN[1]=round_6)  # same code as python_script_3
python_script_nearest_intersect_3 = Python(IN[0]=code_block_13.dat, IN[1]=python_script_6)  # "Python Script-Nearest Intersect Grid Point"; same code as python_script_nearest_intersect
endPoint = Curve.EndPoint(curve=location_4)
X_4 = Point.X(point=endPoint)
code_block_15 = CodeBlock { 1000; 1; }
div_7 = X_4 / code_block_15.out0
round_7 = Math.Round(number=div_7, digits=code_block_15.out1)
Y_4 = Point.Y(point=endPoint)
div_8 = Y_4 / code_block_15.out0
round_8 = Math.Round(number=div_8, digits=code_block_15.out1)
python_script_7 = Python(IN[0]=round_7, IN[1]=round_8)  # same code as python_script_3
python_script_nearest_intersect_4 = Python(IN[0]=code_block_13.dat, IN[1]=python_script_7)  # "Python Script-Nearest Intersect Grid Point"; same code as python_script_nearest_intersect
python_script_8 = Python(IN[0]=python_script_nearest_intersect_3, IN[1]=python_script_nearest_intersect_4)  # same code as python_script_3
setParameterByName_3 = Element.SetParameterByName(element=filterByBoolMask_3.out, parameterName=code_block_13.param, value=python_script_8)
byName_5 = Category.ByName(name=code_block.out3)
all_elements_of_category_5 = ElementsOfCategory(Category=byName_5)
code_block_16 = CodeBlock(elems=all_elements_of_category_5, dat=flatten_2, param=code_block_6) { elems; dat; param; }
boundingBox_2 = Element.BoundingBox(element=code_block_16.elems)
flatten_4 = List.Flatten(list=boundingBox_2)
isNull_4 = Object.IsNull(obj=flatten_4)
filterByBoolMask_4 = List.FilterByBoolMask(list=code_block_16.elems, mask=isNull_4)
filterByBoolMask_5 = List.FilterByBoolMask(list=boundingBox_2, mask=isNull_4)
maxPoint_2 = BoundingBox.MaxPoint(boundingBox=filterByBoolMask_5.out)
minPoint_2 = BoundingBox.MinPoint(boundingBox=filterByBoolMask_5.out)
byStartPointEndPoint_2 = Line.ByStartPointEndPoint(startPoint=maxPoint_2, endPoint=minPoint_2)
code_block_17 = CodeBlock { 0.5; }
pointAtParameter_2 = Curve.PointAtParameter(curve=byStartPointEndPoint_2, param=code_block_17)
X_5 = Point.X(point=pointAtParameter_2)
code_block_18 = CodeBlock { 1000; 1; }
div_9 = X_5 / code_block_18.out0
round_9 = Math.Round(number=div_9, digits=code_block_18.out1)
Y_5 = Point.Y(point=pointAtParameter_2)
div_10 = Y_5 / code_block_18.out0
round_10 = Math.Round(number=div_10, digits=code_block_18.out1)
python_script_9 = Python(IN[0]=round_9, IN[1]=round_10)  # same code as python_script_3
python_script_nearest_intersect_5 = Python(IN[0]=code_block_16.dat, IN[1]=python_script_9)  # "Python Script-Nearest Intersect Grid Point"; same code as python_script_nearest_intersect
setParameterByName_4 = Element.SetParameterByName(element=filterByBoolMask_4.out, parameterName=code_block_16.param, value=python_script_nearest_intersect_5)
byName_6 = Category.ByName(name=code_block.out4)
all_elements_of_category_6 = ElementsOfCategory(Category=byName_6)
code_block_19 = CodeBlock(elems=all_elements_of_category_6, dat=flatten_2, param=code_block_6) { elems; dat; param; }
boundingBox_3 = Element.BoundingBox(element=code_block_19.elems)
flatten_5 = List.Flatten(list=boundingBox_3)
isNull_5 = Object.IsNull(obj=flatten_5)
filterByBoolMask_6 = List.FilterByBoolMask(list=code_block_19.elems, mask=isNull_5)
filterByBoolMask_7 = List.FilterByBoolMask(list=boundingBox_3, mask=isNull_5)
maxPoint_3 = BoundingBox.MaxPoint(boundingBox=filterByBoolMask_7.out)
minPoint_3 = BoundingBox.MinPoint(boundingBox=filterByBoolMask_7.out)
byStartPointEndPoint_3 = Line.ByStartPointEndPoint(startPoint=maxPoint_3, endPoint=minPoint_3)
code_block_20 = CodeBlock { 0.5; }
pointAtParameter_3 = Curve.PointAtParameter(curve=byStartPointEndPoint_3, param=code_block_20)
X_6 = Point.X(point=pointAtParameter_3)
code_block_21 = CodeBlock { 1000; 1; }
div_11 = X_6 / code_block_21.out0
round_11 = Math.Round(number=div_11, digits=code_block_21.out1)
Y_6 = Point.Y(point=pointAtParameter_3)
div_12 = Y_6 / code_block_21.out0
round_12 = Math.Round(number=div_12, digits=code_block_21.out1)
python_script_10 = Python(IN[0]=round_11, IN[1]=round_12)  # same code as python_script_3
python_script_nearest_intersect_6 = Python(IN[0]=code_block_19.dat, IN[1]=python_script_10)  # "Python Script-Nearest Intersect Grid Point"; same code as python_script_nearest_intersect
setParameterByName_5 = Element.SetParameterByName(element=filterByBoolMask_6.out, parameterName=code_block_19.param, value=python_script_nearest_intersect_6)
byName_7 = Category.ByName(name=code_block.out5)
all_elements_of_category_7 = ElementsOfCategory(Category=byName_7)
code_block_22 = CodeBlock(elems=all_elements_of_category_7, dat=flatten_2, param=code_block_6) { elems; dat; param; }
boundingBox_4 = Element.BoundingBox(element=code_block_22.elems)
flatten_6 = List.Flatten(list=boundingBox_4)
isNull_6 = Object.IsNull(obj=flatten_6)
filterByBoolMask_8 = List.FilterByBoolMask(list=code_block_22.elems, mask=isNull_6)
filterByBoolMask_9 = List.FilterByBoolMask(list=boundingBox_4, mask=isNull_6)
maxPoint_4 = BoundingBox.MaxPoint(boundingBox=filterByBoolMask_9.out)
minPoint_4 = BoundingBox.MinPoint(boundingBox=filterByBoolMask_9.out)
byStartPointEndPoint_4 = Line.ByStartPointEndPoint(startPoint=maxPoint_4, endPoint=minPoint_4)
code_block_23 = CodeBlock { 0.5; }
pointAtParameter_4 = Curve.PointAtParameter(curve=byStartPointEndPoint_4, param=code_block_23)
X_7 = Point.X(point=pointAtParameter_4)
code_block_24 = CodeBlock { 1000; 1; }
div_13 = X_7 / code_block_24.out0
round_13 = Math.Round(number=div_13, digits=code_block_24.out1)
Y_7 = Point.Y(point=pointAtParameter_4)
div_14 = Y_7 / code_block_24.out0
round_14 = Math.Round(number=div_14, digits=code_block_24.out1)
python_script_11 = Python(IN[0]=round_13, IN[1]=round_14)  # same code as python_script_3
python_script_nearest_intersect_7 = Python(IN[0]=code_block_22.dat, IN[1]=python_script_11)  # "Python Script-Nearest Intersect Grid Point"; same code as python_script_nearest_intersect
setParameterByName_6 = Element.SetParameterByName(element=filterByBoolMask_8.out, parameterName=code_block_22.param, value=python_script_nearest_intersect_7)
filterByBoolMask_10 = List.FilterByBoolMask(list=code_block_9.elems, mask=isNull_2)
python_script_setup_units = Python()  # unwired: IN[0]
# ---------- python_script_setup_units.python (60 lines) ----------
# Load the Python Standard and DesignScript Libraries
import sys
import clr
clr.AddReference('ProtoGeometry')
from Autodesk.DesignScript.Geometry import *

clr.AddReference('RevitAPI')
from Autodesk.Revit.DB import *
clr.AddReference('RevitAPIUI')
from Autodesk.Revit.UI import TaskDialog
clr.AddReference("RevitNodes")
import Revit
clr.ImportExtensions(Revit.Elements)
clr.AddReference("RevitServices")
import RevitServices
from RevitServices.Persistence import DocumentManager
from RevitServices.Transactions import TransactionManager
from System.Collections.Generic import *
clr.ImportExtensions(Revit.GeometryConversion)

##
doc = DocumentManager.Instance.CurrentDBDocument
uiapp = DocumentManager.Instance.CurrentUIApplication
app = uiapp.Application


# The inputs to this node will be stored as a list in the IN variables.
dataEnteringNode = IN

# Place your code below this line


t = Transaction(doc)
	
t.Start("Units setup")
try:
	#Area
	unit = Units(UnitSystem.Metric)

	fmOp = FormatOptions(DisplayUnitType.DUT_SQUARE_METERS,UnitSymbolType.UST_NONE,0.001)
	
	unit.SetFormatOptions(UnitType.UT_Area,fmOp)
	
	doc.SetUnits(unit)
	#Volume
	unit1 = Units(UnitSystem.Metric)

	fmOp1 = FormatOptions(DisplayUnitType.DUT_CUBIC_METERS,UnitSymbolType.UST_NONE,0.001)
	
	unit.SetFormatOptions(UnitType.UT_Volume,fmOp1)
	
	doc.SetUnits(unit)
	#doc.GetUnits().SetFormatOptions(UnitType.UT_Area,fmOp)
except Exception, e:
	pass
t.Commit()


# Assign your output to the OUT variable.
OUT = 0
# ----------------------------------------
