# Dynamo graph Location 210511-2.dyn (Dynamo 2.1.0.7500)

select_model_elements = DSModelElementsSelection()  # 7 picked in the model
categories = StringInput("""Structural Foundations
Structural Framing
Structural Columns
Walls
Floors
Stairs
Parts
Generic Models
Curtain Panels
Roofs""")  # graph input
combine_file_yes_true_file_path = BoolSelector(false)  # graph input
file_path = Filename("No file selected.")  # graph input
python_script = Python(IN[0]=categories, IN[1]=combine_file_yes_true_file_path, IN[2]=file_path)
# ---------- python_script.python (73 lines) ----------
# Load the Python Standard and DesignScript Libraries
import sys,os,json,tempfile
from shutil import copyfile
from json import *
import clr
clr.AddReference('ProtoGeometry')
from Autodesk.DesignScript.Geometry import *
clr.AddReference('RevitAPI')
from Autodesk.Revit.DB import *
clr.AddReference('RevitAPIUI')
from Autodesk.Revit.UI import TaskDialog
clr.AddReference("RevitNodes")
import Revit
clr.ImportExtensions(Revit.Elements)
clr.AddReference("RevitServices")
import RevitServices
from RevitServices.Persistence import DocumentManager
from RevitServices.Transactions import TransactionManager
from System.Collections.Generic import *
clr.ImportExtensions(Revit.GeometryConversion)

## add module director
dynPyDir = r"C:\Users\USER\Documents\GitHub\cofico\cofico\FROM BIM MASTER TEMP 210412\Python\pythonDynamo"#r"\\hcmcfcfs01\databim$\BimESC\00-BIM STANDARD\PYTHON\pythondynamo"
sys.path.append(dynPyDir)
import pyDyn
from pyDyn import *
##
doc = DocumentManager.Instance.CurrentDBDocument
uiapp = DocumentManager.Instance.CurrentUIApplication
app = uiapp.Application

opt = Options()
categories = doc.Settings.Categories

# The inputs to this node will be stored as a list in the IN variables.
dataEnteringNode = IN
#elems = UnwrapElement(IN[0])
cates = IN[0]
combineFlag = IN[1]
filePathComb  = IN[2]

elems = getAllElementsOfCategories(splitDynString(cates),doc)


# Place your code below this line
path = revitDir(doc)[0]+revitDir(doc)[1]+'.json'
fileName = revitDir(doc)[1]+'.json'
tempfilepath = getTempFilePath(fileName)
filepath = revitDir(doc)[0]+revitDir(doc)[1]+'.json'
#locations = getLocationPoints(elems)
data = []
for e in elems:
	try:
		dic = {}
		dic['UniqueId'] = e.UniqueId
		dic['LocationType'] = checkLocation(e)
		dic['LocationPoint'] = getLocationPoints1(e)
		data.append(dic)
	except:
		pass

if combineFlag:
	combDat = readJson(filePathComb)
	union = combDat + data
	combDataStr = jsonString(union)
	#tempfilepathComb = getTempFilePath(filePathComb)
	OUT = writeTxtStringToFile2(filePathComb,combDataStr)
else:
	
	dataStr = jsonString(data)	
	OUT = writeTxtStringToFile(tempfilepath,filepath,dataStr)

#OUT = data
# ----------------------------------------
watch = Watch(python_script)
