# Dynamo graph 02-INPUT-00-CREATE SHARED PARAMETER & SETUP UNIT-210427.dyn (Dynamo 2.1.0.7500)

python_script_units = Python()  # unwired: IN[0]
# ---------- python_script_units.python (60 lines) ----------
# Load the Python Standard and DesignScript Libraries
import sys
import clr
clr.AddReference('ProtoGeometry')
from Autodesk.DesignScript.Geometry import *

clr.AddReference('RevitAPI')
from Autodesk.Revit.DB import *
clr.AddReference('RevitAPIUI')
from Autodesk.Revit.UI import TaskDialog
clr.AddReference("RevitNodes")
import Revit
clr.ImportExtensions(Revit.Elements)
clr.AddReference("RevitServices")
import RevitServices
from RevitServices.Persistence import DocumentManager
from RevitServices.Transactions import TransactionManager
from System.Collections.Generic import *
clr.ImportExtensions(Revit.GeometryConversion)

##
doc = DocumentManager.Instance.CurrentDBDocument
uiapp = DocumentManager.Instance.CurrentUIApplication
app = uiapp.Application


# The inputs to this node will be stored as a list in the IN variables.
dataEnteringNode = IN

# Place your code below this line


t = Transaction(doc)
	
t.Start("Units setup")
try:
	#Area
	unit = Units(UnitSystem.Metric)

	fmOp = FormatOptions(DisplayUnitType.DUT_SQUARE_METERS,UnitSymbolType.UST_NONE,0.001)
	
	unit.SetFormatOptions(UnitType.UT_Area,fmOp)
	
	doc.SetUnits(unit)
	#Volume
	unit1 = Units(UnitSystem.Metric)

	fmOp1 = FormatOptions(DisplayUnitType.DUT_CUBIC_METERS,UnitSymbolType.UST_NONE,0.001)
	
	unit.SetFormatOptions(UnitType.UT_Volume,fmOp1)
	
	doc.SetUnits(unit)
	#doc.GetUnits().SetFormatOptions(UnitType.UT_Area,fmOp)
except Exception, e:
	pass
t.Commit()


# Assign your output to the OUT variable.
OUT = 0
# ----------------------------------------
list_category = StringInput("""Structural Foundations
Structural Framing
Structural Columns
Walls
Floors
Stairs
Parts
Generic Models
Specialty Equipment
Curtain Wall Mullions
Curtain Panels
Roofs
Railings""")  # graph input
property_group_a = StringInput("Construction")  # graph input
property_group_b = StringInput("Structural")  # graph input
a_or_b_true_a = BoolSelector(true)  # graph input
parameter_prefix = StringInput("COF")  # graph input
python_script_create_parameters = Python(IN[0]=list_category, IN[1]=property_group_a, IN[2]=property_group_b, IN[3]=a_or_b_true_a, IN[4]=parameter_prefix)
# ---------- python_script_create_parameters.python (62 lines) ----------
# Load the Python Standard and DesignScript Libraries
import sys
import clr
clr.AddReference('ProtoGeometry')
from Autodesk.DesignScript.Geometry import *

clr.AddReference('RevitAPI')
from Autodesk.Revit.DB import *
from Autodesk.Revit.DB.ExternalFileUtils import *
from Autodesk.Revit.Creation import *

clr.AddReference('RevitAPIUI')
from Autodesk.Revit.UI import TaskDialog
clr.AddReference("RevitNodes")
import Revit
clr.ImportExtensions(Revit.Elements)
clr.AddReference("RevitServices")
import RevitServices
from RevitServices.Persistence import DocumentManager
from RevitServices.Transactions import TransactionManager
from System.Collections.Generic import *
clr.ImportExtensions(Revit.GeometryConversion)
import itertools

## add module director
dynPyDir = r"C:\Users\USER\Documents\GitHub\cofico\cofico\FROM BIM MASTER TEMP 210412\Python\pythonDynamo"#r"\\hcmcfcfs01\databim$\BimESC\00-BIM STANDARD\PYTHON\pythondynamo"
sys.path.append(dynPyDir)
import pyDyn
from pyDyn import *

doc = DocumentManager.Instance.CurrentDBDocument
uiapp = DocumentManager.Instance.CurrentUIApplication
app = uiapp.Application
opt = Options()
	
# The inputs to this node will be stored as a list in the IN variables.
dataEnteringNode = IN

cates = IN[0]
paramGroupA = IN[1]
paramGroupB = IN[2]
isAB = IN[3]
prefix = "COF"

paramGroup = ""
if isAB:
	paramGroup = paramGroupA
else:
	paramGroup = paramGroupB

paraDefs = []
paraDefNames = []
definition=""

newcats = splitDynString(cates)


paraDefs = getParameterDefinitions(doc)[0]
paraDefNames = getParameterDefinitions(doc)[1]
res = createMultiParameter(doc,paraDefs,newcats,paramGroup,prefix)
# Assign yourr output to the OUT variable.
OUT = res#newcats,paraDefNames
# ----------------------------------------
watch = Watch(python_script_create_parameters)
