# Dynamo graph 06-INPUT-04-UniqueId-210427.dyn (Dynamo 2.1.0.7500)

categories = StringInput("""Structural Foundations
Structural Framing
Structural Columns
Walls
Floors
Stairs
Parts
Generic Models""")  # graph input
# note: Ghi mã Uquiqe Id của đối tượng vào Parameter chỉ định
parameter_name = StringInput("COF_GEN__UniqueID")  # graph input
python_script_get_elements_of = Python(IN[0]=categories, IN[1]=parameter_name)  # "Python Script-Get Elements Of Listed Categories then Write UniID"
# ---------- python_script_get_elements_of.python (47 lines) ----------
# Load the Python Standard and DesignScript Libraries
import sys,os,json,tempfile,re
from shutil import copyfile
from json import *
import clr
clr.AddReference('ProtoGeometry')
from Autodesk.DesignScript.Geometry import *
clr.AddReference('RevitAPI')
from Autodesk.Revit.DB import *
clr.AddReference('RevitAPIUI')
from Autodesk.Revit.UI import TaskDialog
clr.AddReference("RevitNodes")
import Revit
clr.ImportExtensions(Revit.Elements)
clr.AddReference("RevitServices")
import RevitServices
from RevitServices.Persistence import DocumentManager
from RevitServices.Transactions import TransactionManager
from System.Collections.Generic import *
clr.ImportExtensions(Revit.GeometryConversion)
## add module director
dynPyDir = r"C:\Users\USER\Documents\GitHub\cofico\cofico\FROM BIM MASTER TEMP 210412\Python\pythonDynamo"#r"\\hcmcfcfs01\databim$\BimESC\00-BIM STANDARD\PYTHON\pythondynamo"
sys.path.append(dynPyDir)
import pyDyn
from pyDyn import *
##
doc = DocumentManager.Instance.CurrentDBDocument
uiapp = DocumentManager.Instance.CurrentUIApplication
app = uiapp.Application

opt = Options()
categories = doc.Settings.Categories

# The inputs to this node will be stored as a list in the IN variables.
dataEnteringNode = IN
cates = IN[0]
paramName = IN[1]
# Place your code below this line

newcats = splitDynString(cates)

elements = getAllElementsOfCategories(newcats,doc)

res = setParameterUniqueId(doc,elements,paramName)

# Assign your output to the OUT variable.
OUT = res
# ----------------------------------------
