# Dynamo graph UPDATE JSON-210427.dyn (Dynamo 2.3.0.5885)

file_path = Filename("..\..\..\..\01_PROJECTS\CH GARDEN II-1909\02-ON PLACE\CHG-S-TW A-5F-TOWER A STRUCTURE TYPICAL 5F-8F-210426.json")
map_schema_ex_parama_paramb = StringInput("""Category	COF_GEN__Category
UniqiueId	COF_GEN__UniqueID
Category	COF_GEN__UniqueID""")  # graph input

# group: Write Element Properties (Instance and Type) to Json file
python_script_read_json = Python(IN[0]=file_path, IN[1]=map_schema_ex_parama_paramb)
# ---------- python_script_read_json.python (43 lines) ----------
# Load the Python Standard and DesignScript Libraries
import sys,os,json,tempfile,re
from shutil import copyfile
from json import *
import clr
clr.AddReference('ProtoGeometry')
from Autodesk.DesignScript.Geometry import *
clr.AddReference('RevitAPI')
from Autodesk.Revit.DB import *
clr.AddReference('RevitAPIUI')
from Autodesk.Revit.UI import TaskDialog
clr.AddReference("RevitNodes")
import Revit
clr.ImportExtensions(Revit.Elements)
clr.AddReference("RevitServices")
import RevitServices
from RevitServices.Persistence import DocumentManager
from RevitServices.Transactions import TransactionManager
from System.Collections.Generic import *
clr.ImportExtensions(Revit.GeometryConversion)

## add module director
dynPyDir = r"\\hcmcfcfs01\databim$\BimESC\00-BIM STANDARD\PYTHON\pythondynamo"
sys.path.append(dynPyDir)
import pyDyn
from pyDyn import *
##
doc = DocumentManager.Instance.CurrentDBDocument
uiapp = DocumentManager.Instance.CurrentUIApplication
app = uiapp.Application

opt = Options()
categories = doc.Settings.Categories
# The inputs to this node will be stored as a list in the IN variables.
dataEnteringNode = IN
jsonPath = IN[0]
schema = IN[1]

list = [line.split("\t") for line in splitDynString(schema)]

data = readJson(jsonPath)

OUT =  jsonPath,list
# ----------------------------------------

watch = Watch(python_script_read_json)
