# Dynamo graph QTO-Wall-210419.dyn (Dynamo 2.10.0.3455)

python_script_check = Python()  # "Python Script-Check ProtoGeometry.dll"; IronPython2; unwired: IN[0]
# ---------- python_script_check.python (19 lines) ----------
# Load the Python Standard and DesignScript Libraries
import sys, os
import clr
clr.AddReference('ProtoGeometry')
import Autodesk.DesignScript.Geometry
from Autodesk.DesignScript.Geometry import *
clr.AddReference("RevitNodes")
import Revit
clr.ImportExtensions(Revit.Elements)
clr.ImportExtensions(Revit.GeometryConversion)
# The inputs to this node will be stored as a list in the IN variables.
dataEnteringNode = IN

# Place your code below this line
path1 = os.path.abspath(Autodesk.DesignScript.__file__)

path2 = os.path.dirname(Autodesk.DesignScript.Geometry.__file__)
# Assign your output to the OUT variable.
OUT = clr.References[2].Location,dir(clr.References[2].Autodesk.DesignScript.Geometry),dir(clr)
# ----------------------------------------
watch = Watch(python_script_check)
select_model_element = DSModelElementSelection()  # 1 picked in the model
solids = Element.Solids(element=select_model_element)
getLocation = Element.GetLocation(element=select_model_element)
startPoint = Curve.StartPoint(curve=getLocation)
ZAxis = Vector.ZAxis()
code_block = CodeBlock { 100; }
translate = Geometry.Translate(geometry=startPoint, direction=ZAxis, distance=code_block)
byLineAndPoint = Plane.ByLineAndPoint(line=getLocation, point=translate)
intersect = Geometry.Intersect(geometry=solids, other=byLineAndPoint)
perimeterCurves = Surface.PerimeterCurves(surface=intersect)  # frozen
select_model_element_link_revit = DSModelElementSelection()  # 1 picked in the model
python_script = Python(IN[0]=select_model_element, IN[1]=select_model_element_link_revit)  # IronPython2
# ---------- python_script.python (50 lines) ----------
# Load the Python Standard and DesignScript Libraries
import sys,os,json,tempfile
from shutil import copyfile
from json import *
import clr
clr.AddReference('ProtoGeometry')
from Autodesk.DesignScript.Geometry import *
clr.AddReference('RevitAPI')
from Autodesk.Revit.DB import *
clr.AddReference('RevitAPIUI')
from Autodesk.Revit.UI import TaskDialog
clr.AddReference("RevitNodes")
import Revit
clr.ImportExtensions(Revit.Elements)
clr.AddReference("RevitServices")
import RevitServices
from RevitServices.Persistence import DocumentManager
from RevitServices.Transactions import TransactionManager
from System.Collections.Generic import *
clr.ImportExtensions(Revit.GeometryConversion)

## add module director
dynPyDir = r"\\hcmcfcfs01\databim$\BimESC\00-BIM STANDARD\PYTHON\pythondynamo"
sys.path.append(dynPyDir)
import pyDyn
from pyDyn import *
##

# The inputs to this node will be stored as a list in the IN variables.
dataEnteringNode = IN
element = UnwrapElement(IN[0])
revitLink = UnwrapElement(IN[1])
revitLink_Doc = getLinkDoc(revitLink)
# Place your code below this line
catName1 = "Structural Columns"
catName2 = "Structural Framing"
catNames = """Structural Foundations
Structural Framing
Structural Columns
Walls
Floors"""
intersect_elements = allElemsIntersected(element,doc)
intersect_LinkElements = allElemsIntersected(element,revitLink_Doc)
intersect_columns = allElemsIntersectedOfCat(element,catName1,revitLink_Doc)
intersect_beams = allElemsIntersectedOfCat(element,catName2,revitLink_Doc)
locationCurve = getLocationCurve(element)


# Assign your output to the OUT variable.
OUT = next(intersect_columns)
# ----------------------------------------
watch_2 = Watch(python_script)
solids_2 = Element.Solids(element=watch_2)
subtractFrom = Surface.SubtractFrom(surface=intersect, trimmingEntity=solids_2)
python_script_2 = Python(IN[0]=select_model_element, IN[1]=select_model_element_link_revit)  # IronPython2
# ---------- python_script_2.python (50 lines) ----------
# Load the Python Standard and DesignScript Libraries
import sys,os,json,tempfile
from shutil import copyfile
from json import *
import clr
clr.AddReference('ProtoGeometry')
from Autodesk.DesignScript.Geometry import *
clr.AddReference('RevitAPI')
from Autodesk.Revit.DB import *
clr.AddReference('RevitAPIUI')
from Autodesk.Revit.UI import TaskDialog
clr.AddReference("RevitNodes")
import Revit
clr.ImportExtensions(Revit.Elements)
clr.AddReference("RevitServices")
import RevitServices
from RevitServices.Persistence import DocumentManager
from RevitServices.Transactions import TransactionManager
from System.Collections.Generic import *
clr.ImportExtensions(Revit.GeometryConversion)

## add module director
dynPyDir = r"\\hcmcfcfs01\databim$\BimESC\00-BIM STANDARD\PYTHON\pythondynamo"
sys.path.append(dynPyDir)
import pyDyn
from pyDyn import *
##

# The inputs to this node will be stored as a list in the IN variables.
dataEnteringNode = IN
element = UnwrapElement(IN[0])
revitLink = UnwrapElement(IN[1])
revitLink_Doc = getLinkDoc(revitLink)
# Place your code below this line
catName1 = "Structural Columns"
catName2 = "Structural Framing"
catNames = """Structural Foundations
Structural Framing
Structural Columns
Walls
Floors"""
intersect_elements = allElemsIntersected(element,doc)
intersect_LinkElements = allElemsIntersected(element,revitLink_Doc)
intersect_columns = allElemsIntersectedOfCat(element,catName1,revitLink_Doc)
intersect_beams = allElemsIntersectedOfCat(element,catName2,revitLink_Doc)
locationCurve = getLocationCurve(element)


# Assign your output to the OUT variable.
OUT = next(intersect_beams)
# ----------------------------------------
solids_3 = Element.Solids(element=python_script_2)
subtractFrom_2 = Surface.SubtractFrom(surface=subtractFrom, trimmingEntity=solids_3)
python_script_3 = Python(IN[0]=select_model_element, IN[1]=select_model_element_link_revit)  # IronPython2
# ---------- python_script_3.python (68 lines) ----------
# Load the Python Standard and DesignScript Libraries
import sys,os,json,tempfile
from shutil import copyfile
from json import *
import clr
clr.AddReference('ProtoGeometry')
import Autodesk.DesignScript.Geometry
from Autodesk.DesignScript.Geometry import *
clr.AddReference('RevitAPI')
from Autodesk.Revit.DB import *
import Autodesk.Revit.DB.BooleanOperationsUtils as BOU
import Autodesk.Revit.DB.SolidSolidCutUtils as SSUT

clr.AddReference('RevitAPIUI')
from Autodesk.Revit.UI import TaskDialog
clr.AddReference("RevitNodes")
import Revit
clr.ImportExtensions(Revit.Elements)
clr.AddReference("RevitServices")
import RevitServices
from RevitServices.Persistence import DocumentManager
from RevitServices.Transactions import TransactionManager
from System.Collections.Generic import *
clr.ImportExtensions(Revit.GeometryConversion)

## add module director
dynPyDir = r"\\hcmcfcfs01\databim$\BimESC\00-BIM STANDARD\PYTHON\pythondynamo"
sys.path.append(dynPyDir)
import pyDyn
from pyDyn import *
##

# The inputs to this node will be stored as a list in the IN variables.
dataEnteringNode = IN
element = UnwrapElement(IN[0])
revitLink = UnwrapElement(IN[1])
revitLink_Doc = getLinkDoc(revitLink)
# Place your code below this line
catName1 = "Structural Columns"
catName2 = "Structural Framing"
catNames = """Structural Foundations
Structural Framing
Structural Columns
Walls
Floors"""
intersect_elements = allElemsIntersected(element,doc)
intersect_LinkElements = allElemsIntersected(element,revitLink_Doc)
intersect_columns = allElemsIntersectedOfCat(element,catName1,revitLink_Doc)
intersect_beams = allElemsIntersectedOfCat(element,catName2,revitLink_Doc)
locationCurve = getLocationCurve(element)

element_Solid = UnionSolid(getSolids(element))
intersect_beam_solids = [UnionSolid(getSolids(beam)) for beam in intersect_beams]

intersect_solids = []
for beam_solid in intersect_beam_solids:
	try:
		intersect = BOU.ExecuteBooleanOperation(element_Solid,beam_solid,BooleanOperationsType.Intersect)
		different = BOU.ExecuteBooleanOperation(element_Solid,beam_solid,BooleanOperationsType.Difference)#SSUT.AddCutBetweenSolids(doc,beam_solid,element_Solid)#
		union = BOU.ExecuteBooleanOperation(element_Solid,beam_solid,BooleanOperationsType.Union)
		flag = beam_solid.Volume + element_Solid.Volume - union.Volume == intersect.Volume
		if not flag:
			intersect_solids.append(beam_solid)
	except Exception, ex:
		intersect_solids.append(ex)
		pass
# Assign your output to the OUT variable.
OUT = intersect_solids#dir(element_Solid)
# ----------------------------------------
watch_3 = Watch(python_script_3)
