# Dynamo graph test geo.dyn (Dynamo 2.10.0.3455)

code_block = CodeBlock { 10; }
byWidthLength = Rectangle.ByWidthLength(width=code_block, length=code_block)
ZAxis = Vector.ZAxis()
translate = Geometry.Translate(geometry=byWidthLength, direction=ZAxis, distance=code_block)
list_create = List.Create(item0=translate, item1=byWidthLength)
byLoft = Solid.ByLoft(crossSections=list_create)
byCoordinates = Point.ByCoordinates()
byCoordinates_2 = Point.ByCoordinates(x=code_block)
byStartPointEndPoint = Line.ByStartPointEndPoint(startPoint=byCoordinates, endPoint=byCoordinates_2)
byCoordinates_3 = Point.ByCoordinates(z=code_block)
byLineAndPoint = Plane.ByLineAndPoint(line=byStartPointEndPoint, point=byCoordinates_3)
intersect = Geometry.Intersect(geometry=byLoft, other=byLineAndPoint)
