# Dynamo graph FW Scaffolding for Beam-210420.dyn (Dynamo 2.1.0.7500)

select_model_elements = DSModelElementsSelection()  # 4 picked in the model
select_model_element = DSModelElementSelection()  # 1 picked in the model
python_script = Python(IN[0]=select_model_element)
# ---------- python_script.python (41 lines) ----------
# Load the Python Standard and DesignScript Libraries
import sys,os,json,tempfile
from shutil import copyfile
from json import *
import clr
clr.AddReference('ProtoGeometry')
import Autodesk.DesignScript.Geometry
from Autodesk.DesignScript.Geometry import *
clr.AddReference('RevitAPI')
from Autodesk.Revit.DB import *
import Autodesk.Revit.DB.BooleanOperationsUtils as BOU
import Autodesk.Revit.DB.SolidSolidCutUtils as SSUT
#clr.AddReference('RevitAPIUI')
#from Autodesk.Revit.UI import TaskDialog
clr.AddReference("RevitNodes")
import Revit
clr.ImportExtensions(Revit.Elements)
clr.ImportExtensions(Revit.GeometryConversion)
clr.AddReference("RevitServices")
import RevitServices
from RevitServices.Persistence import DocumentManager
from RevitServices.Transactions import TransactionManager
from System.Collections.Generic import *
clr.ImportExtensions(Revit.GeometryConversion)
"""
## add module director
dynPyDir = r"C:\Users\USER\Documents\GitHub\cofico\cofico\FROM BIM MASTER TEMP 210412\Python\pythonDynamo"
sys.path.append(dynPyDir)
import pyDyn
from pyDyn import *
##
"""
# The inputs to this node will be stored as a list in the IN variables.
dataEnteringNode = IN

# Place your code below this line
beam = UnwrapElement(IN[0])


# Assign your output to the OUT variable.
OUT = beam
# ----------------------------------------
watch = Watch(python_script)
python_script_2 = Python()  # unwired: IN[0]
# ---------- python_script_2.python (20 lines) ----------
# Load the Python Standard and DesignScript Libraries
import sys, os
import clr
clr.AddReference('ProtoGeometry')
import Autodesk.DesignScript.Geometry
from Autodesk.DesignScript.Geometry import *

clr.AddReference("RevitNodes")
import Revit
clr.ImportExtensions(Revit.Elements)
clr.ImportExtensions(Revit.GeometryConversion)
# The inputs to this node will be stored as a list in the IN variables.
dataEnteringNode = IN

# Place your code below this line
#path1 = os.path.abspath(Autodesk.DesignScript.__file__)
#path2 = os.path.dirname(Autodesk.DesignScript.Geometry.__file__)

# Assign your output to the OUT variable.
OUT = dir(Revit.Elements)#clr.References[3].Location#,dir(clr.References[3].Autodesk.DesignScript.Geometry),dir(clr)
# ----------------------------------------
