# Dynamo graph SCAFOLDING 210422.dyn (Dynamo 2.3.0.5885)

select_model_element = DSModelElementSelection()  # 1 picked in the model; frozen
location = StructuralFraming.Location(structuralFraming=select_model_element)
code_block = CodeBlock { 0.5; }
pointAtParameter = Curve.PointAtParameter(curve=location, param=code_block)
select_model_elements = DSModelElementsSelection()  # 7 picked in the model; frozen
location_2 = StructuralFraming.Location(structuralFraming=select_model_elements)
pointAtParameter_2 = Curve.PointAtParameter(curve=location_2, param=code_block)
code_block_2 = CodeBlock(curve1=location) { x=y=0; vectorX = Vector.XAxis(); length = Curve.Length(curve1); param = 0.5; segment1 = 900; segment2 = 1200; }
byCoordinates = Point.ByCoordinates(x=code_block_2.x, y=code_block_2.length)
byStartPointDirectionLength = Line.ByStartPointDirectionLength(startPoint=byCoordinates, direction=code_block_2.vectorX, length=code_block_2.length)
pointAtParameter_3 = Curve.PointAtParameter(curve=byStartPointDirectionLength, param=code_block_2.param)
code_block_3 = CodeBlock(curve1=location_2) { x=y=0; vectorX = Vector.XAxis(); length = Curve.Length(curve1); param = 0.5; }
byCoordinates_2 = Point.ByCoordinates(x=code_block_3.x, y=code_block_3.length)
byStartPointDirectionLength_2 = Line.ByStartPointDirectionLength(startPoint=byCoordinates_2, direction=code_block_3.vectorX, length=code_block_3.length)
pointAtParameter_4 = Curve.PointAtParameter(curve=byStartPointDirectionLength_2, param=code_block_3.param)
segmentLengthAtParameter = Curve.SegmentLengthAtParameter(curve=byStartPointDirectionLength, param=code_block_2.param)
mod = segmentLengthAtParameter % code_block_2.segment2
mod_2 = mod % code_block_2.segment1
lt = mod_2 < code_block_2.segment1
if_ = If(test=lt, true=mod, false=mod_2)
pointAtSegmentLength = Curve.PointAtSegmentLength(curve=byStartPointDirectionLength, segmentLength=if_)
python_script = Python()  # unwired: IN[0]
# ---------- python_script.python (70 lines) ----------
# Load the Python Standard and DesignScript Libraries
import sys
import clr
clr.AddReference('ProtoGeometry')
from Autodesk.DesignScript.Geometry import *

# The inputs to this node will be stored as a list in the IN variables.
dataEnteringNode = IN

# Place your code below this line
def matrix_Multiply_number(matrix1,number):
	matrixRes = []
	for row in matrix1:
		newrow = []
		for col in row:
			newrow.append(col*number)		
		matrixRes.append(newrow)
	return matrixRes

def matrix_Multiply_nDx1D(matrixND,matrix1D):
	matrixRes = []		
	for row in matrixND:
		newrow = []
		for col in row:
			xy = []
			for val in matrix1D:
				xy.append(val*col)
			newrow.append(xy)		
		matrixRes.append(newrow)
	return matrixRes

def matrix_Multiply_matrix(matrix1,matrix2):
	multiply = []
	for i in range(len(matrix1)):
		row = []
		for j in range(len(matrix1[i])):
			row.append(matrix1[i][j]*matrix2[i][j])		
		multiply.append(row)
	return multiply

def matrix_posittion(row,col,step):
	matrixRes = []
	for r in range(row):
		listlist =[]
		for c in range(col):
			list = []
			list.append(r*step)
			list.append(c*step)			
			listlist.append(list)

		matrixRes.append(listlist)
	return matrixRes
_incre = 300 # INCREMENT = 300mm

array_600 = [[0,0,0] for i in range(3)]#[[0,0,0]]*3#[[0,0,0],[0,0,0],[0,0,0]]
array_900 = [[0,0,0,0] for i in range(4)]#[[0,0,0,0]]*4#[[0,0,0,0],[0,0,0,0],[0,0,0,0],[0,0,0,0]]
array_1200 = [[0,0,0,0,0] for i in range(5)]#[[0,0,0,0,0],[0,0,0,0,0],[0,0,0,0,0],[0,0,0,0,0],[0,0,0,0,0]]#[[0,0,0,0,0]]*5#

# 1 set 1200 postion matrix
BaseMatrix_1200 = [[0,0,0,0,0] for i in range(5)]
BaseMatrix_1200[0][0] = 1
BaseMatrix_1200[0][4] = 1
BaseMatrix_1200[4][0] = 1
BaseMatrix_1200[4][4] = 1
PositionMatrix_1200 = [[0,1,2,3,4] for i in range(5)]

pos_1200 = matrix_Multiply_nDx1D(PositionMatrix_1200,[300,300])

# Assign your output to the OUT variable.
OUT = matrix_posittion(5,5,300)
# ----------------------------------------
watch = Watch(python_script)
python_script_2 = Python()  # unwired: IN[0]
# ---------- python_script_2.python (17 lines) ----------
# Load the Python Standard and DesignScript Libraries
import sys
import clr
clr.AddReference('ProtoGeometry')
from Autodesk.DesignScript.Geometry import *

modulePath = r"C:\Users\tvpduy\AppData\Local\Programs\Python\Python39\Lib\site-packages"
sys.path.append(modulePath)

import numpy
# The inputs to this node will be stored as a list in the IN variables.
dataEnteringNode = IN

# Place your code below this line

# Assign your output to the OUT variable.
OUT = 0
# ----------------------------------------
