# Dynamo graph Unjoin-2 Categories-210427.dyn (Dynamo 2.3.0.5885)

string_category_name = StringInput("""Structural Foundations
Structural Framing
Structural Columns
Walls
Floors
Stairs
Parts
Generic Models""")  # graph input
python_script = Python(IN[0]=string_category_name)
# ---------- python_script.python (46 lines) ----------
# Load the Python Standard and DesignScript Libraries
import clr, sys,os,json,tempfile
from shutil import copyfile
from json import *


clr.AddReference('ProtoGeometry')
from Autodesk.DesignScript.Geometry import *
clr.AddReference('RevitAPI')
from Autodesk.Revit.DB import *
clr.AddReference('RevitAPIUI')
from Autodesk.Revit.UI import TaskDialog
clr.AddReference("RevitNodes")
import Revit
clr.ImportExtensions(Revit.Elements)
clr.AddReference("RevitServices")
import RevitServices
from RevitServices.Persistence import DocumentManager
from RevitServices.Transactions import TransactionManager
from System.Collections.Generic import *
clr.ImportExtensions(Revit.GeometryConversion)
clr.AddReference('System.Windows.Forms')
import System.Windows.Forms
from System.Windows.Forms import *
import Autodesk.Revit.DB.JoinGeometryUtils as JGU

## add module director
dynPyDir = "\\\\hcmcfcfs01\\databim$\\BimESC\\00-BIM STANDARD\\PYTHON\\pythondynamo"
sys.path.append(dynPyDir)
import pyDyn
from pyDyn import *
##
doc = DocumentManager.Instance.CurrentDBDocument
uiapp = DocumentManager.Instance.CurrentUIApplication
app = uiapp.Application
opt = Options()		
##

# The inputs to this node will be stored as a list in the IN variables.
dataEnteringNode = IN
cates = IN[0]

listCats = splitDynString(cates)
catsDic = orderedCategoryPair(listCats)

OUT = unjoinAll(doc,catsDic,JGU)
# ----------------------------------------
