# Dynamo graph matrixCube-210427.dyn (Dynamo 2.10.0.3455)

select_model_elements = DSModelElementsSelection()  # 1 picked in the model
boundingBox = Element.BoundingBox(element=select_model_elements)
code_block = CodeBlock()
# ---------- code_block.designscript (4 lines) ----------
p1 = Point.ByCoordinates(5000,6000,7000);
p2 = Point.ByCoordinates(10000,15000,0);
p0 = Point.ByCoordinates(0,0,0);
coli = BoundingBox.ByCorners(p1,p2).ToCuboid();
# ----------------------------------------
flip_x = DoubleInput(1)
flip_y = DoubleInput(1)
flip_z = DoubleInput(1)
step_max = DoubleSlider(600, range=600..5000 step 100)
step_height = DoubleSlider(2000, range=1000..2000 step 500)
scale = DoubleSlider(0.6, range=0.1..1 step 0.1)
code_block_2 = CodeBlock(coli=code_block.coli) { Geometry.Translate(Geometry.Translate(coli,Vector.ZAxis(),6500),Vector.XAxis(),1500); }
python_script = Python(IN[0]=code_block.p1, IN[1]=code_block.p2, IN[2]=flip_x, IN[3]=flip_y, IN[4]=flip_z, IN[5]=step_max, IN[6]=step_height, IN[7]=scale, IN[8]=code_block_2)  # IronPython2
# ---------- python_script.python (81 lines) ----------
# Load the Python Standard and DesignScript Libraries
import sys, os
import clr

pathRevitAPI = r"C:\Program Files\Autodesk\Revit 2020" #Revit API path
sys.path.append(pathRevitAPI) # append Path for Add reference
clr.AddReference('RevitAPI')

pathDynamoModule1 = r"C:\Program Files\Autodesk\Revit 2020\AddIns\DynamoForRevit"
if os.path.exists(pathDynamoModule1):
    sys.path.append(pathDynamoModule1)

pathDynamoModule2 = r"C:\Program Files\Autodesk\Revit 2020\AddIns\DynamoForRevit\Revit"
if os.path.exists(pathDynamoModule2):
    sys.path.append(pathDynamoModule2)

clr.AddReference('ProtoGeometry')
import Autodesk.DesignScript.Geometry
from Autodesk.DesignScript.Geometry import *
clr.AddReference('DSCoreNodes')
from DSCore import Math


def checkIntersect(geo,coli):
	return geo.DoesIntersect(coli)		


# The inputs to this node will be stored as a list in the IN variables.
dataEnteringNode = IN

pointA = IN[0]#[0]
pointB = IN[1]#[0]
flipX = IN[2]
flipY = IN[3]
flipZ = IN[4]
stepMax = IN[5]
stepHeight = IN[6]
scale = IN[7]
collison = IN[8]

iniBoundingBox = BoundingBox.ByCorners(pointA,pointB)
minBBpoint = iniBoundingBox.MinPoint
maxBBpoint = iniBoundingBox.MaxPoint

p1 = Point.ByCoordinates(0,0,0)
p2 = Point.ByCoordinates(stepMax*scale,stepMax*scale,stepHeight)
cub = Cuboid.ByCorners(p1,p2)#BoundingBox.ByCorners(p1,p2)#

arrayNumberX = Math.Round(Math.Abs(maxBBpoint.X-minBBpoint.X)/stepMax)
arrayNumberY = Math.Round(Math.Abs(maxBBpoint.Y-minBBpoint.Y)/stepMax)
arrayNumberZ = Math.Round(Math.Abs(maxBBpoint.Z-minBBpoint.Z)/stepHeight)

#cub = Geometry.Translate(cub,minBBpoint.X,minBBpoint.Y,minBBpoint.Z)
arrayCub = []
count = 0
countIntersect = 0

for xx in range(int(arrayNumberX)):
	for yy in range(int(arrayNumberY)):
		for zz in range(int(arrayNumberZ)):			
			p1 = Point.ByCoordinates(0,0,0)
			p3 = Point.ByCoordinates(minBBpoint.X + flipX*xx*stepMax ,minBBpoint.Y  + flipY*yy*stepMax,minBBpoint.Z + flipZ*zz*stepHeight)
			vec = Vector.ByTwoPoints(p1,p3)
			vec2 = Vector.ByTwoPoints(p3,p1)
			
			p1a = Geometry.Translate(p1,vec)
			
			p2a = Geometry.Translate(p2,vec)
			
			cub = Geometry.Translate(cub,vec)
			
			if checkIntersect(cub,collison):
				countIntersect +=1
				arrayCub.append(cub)
			#newCub = BoundingBox.ByCorners(p1a,p2a).ToCuboid()
			#arrayCub.append(newCub)
			cub = Geometry.Translate(cub,vec2)
			count +=1
# Assign your output to the OUT variable.

OUT = cub, count, countIntersect,arrayCub
# ----------------------------------------
code_block_3 = CodeBlock(res=python_script) { c = res[0]; a = res[1]; }
watch_3d = Watch3D(code_block_3.c)
python_script_2 = Python()  # IronPython2; unwired: IN[0]
# ---------- python_script_2.python (17 lines) ----------
# Load the Python Standard and DesignScript Libraries
import sys
import clr
clr.AddReference('ProtoGeometry')
import Autodesk.DesignScript.Geometry
from Autodesk.DesignScript.Geometry import *

clr.AddReference('DSCoreNodes')
from DSCore import Math

# The inputs to this node will be stored as a list in the IN variables.
dataEnteringNode = IN

# Place your code below this line

# Assign your output to the OUT variable.
OUT = dir(Autodesk.DesignScript.Geometry)
# ----------------------------------------
watch = Watch(python_script_2)
watch_2 = Watch(python_script)
watch_3d_2 = Watch3D(code_block_3.a)
code_block_4 = CodeBlock {  }
select_point_on_face = DSPointOnElementSelection()  # 1 picked in the model
select_point_on_face_2 = DSPointOnElementSelection()  # 1 picked in the model
code_block_5 = CodeBlock(pointA=select_point_on_face, pointB=select_point_on_face_2) { pointA[0]; pointB[0]; }
python_script_3 = Python(IN[0]=code_block.p1, IN[1]=code_block.p2, IN[2]=flip_x, IN[3]=flip_y, IN[4]=flip_z, IN[5]=step_max, IN[6]=step_height, IN[7]=scale)  # IronPython2
# ---------- python_script_3.python (39 lines) ----------
# Load the Python Standard and DesignScript Libraries
import sys, os
import clr

pathRevitAPI = r"C:\Program Files\Autodesk\Revit 2020" #Revit API path
sys.path.append(pathRevitAPI) # append Path for Add reference
clr.AddReference('RevitAPI')

pathDynamoModule1 = r"C:\Program Files\Autodesk\Revit 2020\AddIns\DynamoForRevit"
if os.path.exists(pathDynamoModule1):
    sys.path.append(pathDynamoModule1)

pathDynamoModule2 = r"C:\Program Files\Autodesk\Revit 2020\AddIns\DynamoForRevit\Revit"
if os.path.exists(pathDynamoModule2):
    sys.path.append(pathDynamoModule2)

clr.AddReference('ProtoGeometry')
import Autodesk.DesignScript.Geometry
from Autodesk.DesignScript.Geometry import *
clr.AddReference('DSCoreNodes')
from DSCore import Math

# The inputs to this node will be stored as a list in the IN variables.
dataEnteringNode = IN

pointA = IN[0]#[0]
pointB = IN[1]#[0]
flipX = IN[2]
flipY = IN[3]
flipZ = IN[4]
stepMax = IN[5]
stepHeight = IN[6]
scale = IN[7]

box = BoundingBox.ByCorners(pointA,pointB).ToCuboid()

box = Geometry.Translate(box,Vector.ZAxis(),6500)

OUT = box
# ----------------------------------------
